vi "student_LLSE.gvi"   [LabVIEW NXG]
inputs:
  "Error In": error
  "A": c128[][]
  "b": c128[]
outputs:
  "Error Out": error
  "x.estimate": c128[]
  "mean square error": f64
diagram:
  call "Solve Complex Linear Equations (single right hand).gvi"(input matrix=$A, known vector=$b) -> (solution vector=w1)
  $"x.estimate" <- w1
  Complex Conjugate(x + iy=$b) -> w2
  call "Complex Dot Product.gvi"(x vector=w2, y vector=$b) -> (x * y=w3)
  call "Complex A x Vector.gvi"(A=$A, vector=w1) -> (A x vector=w4)
  call "Complex Dot Product.gvi"(x vector=w2, y vector=w4) -> (x * y=w5)
  Subtract(x=w3, y=w5) -> w6
  Absolute Value(x=w6) -> w7
  Square(x=w7) -> w8
  $"mean square error" <- w8
  $"Error Out" <- $"Error In"
