vi "student_direct_equalizer.gvi"   [LabVIEW NXG]
inputs:
  "Modulation Parameters In": T6 = {"Modulation Type"="QPSK", "Control Information\nfor Packet Header/Tail"={"Training Sequence (derived)"=[], "Zero Pad Length"=0}, "RX Oversample Factor"=20, "Synchronization Options"={"Synchronization Method"="Timing Estimation", "Fixed Offset"=0, "Symbol Timing Recovery Method"="Max Energy", "Frame Detection Method"="Sliding Correlator", "Correct Frequency Offset"=FALSE}, "Number of Data Symbols (Derived)"=100, "RX Sample Rate"=4000000, "Pulse Shaping Parameters"={"Modulation Type"="PSK", "Pulse Shaping Filter"="Root Raised Cos", "Filter Parameter"=0.5, "Filter Length (Symbols)"=8}, "Channel Estimation/Equalization Parameters"={"Equalization Method"="Direct", "Channel Estimate Length"=1, "Equalizer Length"=1, "Equalizer Delay"=-1}}
  "Input": c128[]
  "Equalizer Delay": i32
  "error in (no error)": error
outputs:
  "Modulation Parameters Out": T6
  "Filter Estimate": c128[]
  "Mean-Squared Error": f64
  "Actual Equalizer Delay": i32
  "error out": error
panel indicators:
  "Error Code": i32
types:
  T1 = cluster{"Training Sequence (derived)": c128[], "Zero Pad Length": i32}
  T2 = cluster{"Synchronization Method": string, "Fixed Offset": i32, "Symbol Timing Recovery Method": string, "Frame Detection Method": string, "Correct Frequency Offset": bool}
  T3 = enum{"none", "Raised Cosine", "Root Raised Cos", "Gaussian"}
  T4 = cluster{"Modulation Type": enum{"FSK", "PSK", "QAM", "MSK", "PAM", "ASK"}, "Pulse Shaping Filter": T3, "Filter Parameter": f64, "Filter Length (Symbols)": i32}
  T5 = cluster{"Equalization Method": string, "Channel Estimate Length": i32, "Equalizer Length": i32, "Equalizer Delay": i32}
  T6 = cluster{"Modulation Type": string, "Control Information\nfor Packet Header/Tail": T1, "RX Oversample Factor": i32, "Synchronization Options": T2, "Number of Data Symbols (Derived)": i32, "RX Sample Rate": f64, "Pulse Shaping Parameters": T4, "Channel Estimation/Equalization Parameters": T5}
diagram:
  $"Actual Equalizer Delay" <- $"Equalizer Delay"
  $"Modulation Parameters Out" <- $"Modulation Parameters In"
  Property Node(instance in=$"Modulation Parameters In") -> ("Channel Estimation/Equalization Parameters:Equalizer Length"=w1, "Control Information\nfor Packet Header/Tail:Training Sequence (derived)"=w2)
  Array Size(array=w2) -> (size(s)=w3)
  Quotient And Remainder(x=w3, y=2) -> (floor(x/y)=w4)
  Array Subset(array=w2, length0=w4) -> w5
  Decrement(x=w1) -> w6
  Subtract(x=$"Equalizer Delay", y=w6) -> w7
  Array Subset(array=$Input, index0=w7, length0=w1) -> w8
  Array Subset(array=$Input, index0=$"Equalizer Delay", length0=w4) -> w9
  call "student_toeplitz.gvi"(Error In=$"error in (no error)", Row=w8, Column=w9) -> (Error Out=w10, Toeplitz Array=w11)
  call "student_LLSE.gvi"(Error In=w10, A=w11, b=w5) -> (Error Out=w12, x.estimate=w13, mean square error=w14)
  $"Filter Estimate" <- w13
  $"Mean-Squared Error" <- w14
  Property Node(instance in=w12) -> (instance out=w15, "code"=w16)
  $"error out" <- w15
  $"Error Code" <- w16
