vi "student_moose.gvi"   [LabVIEW NXG]
inputs:
  "Modulation Parameters": T6 = {"Modulation Type"="QPSK", "Control Information\nfor Packet Header/Tail"={"Training Sequence (derived)"=[], "Zero Pad Length"=0}, "RX Oversample Factor"=20, "Synchronization Options"={"Synchronization Method"="Timing Estimation", "Fixed Offset"=0, "Symbol Timing Recovery Method"="Max Energy", "Frame Detection Method"="Sliding Correlator", "Correct Frequency Offset"=FALSE}, "Number of Data Symbols (Derived)"=100, "RX Sample Rate"=4000000, "Pulse Shaping Parameters"={"Modulation Type"="PSK", "Pulse Shaping Filter"="Root Raised Cos", "Filter Parameter"=0.5, "Filter Length (Symbols)"=8}, "Channel Estimation/Equalization Parameters"={"Equalization Method"="Direct", "Channel Estimate Length"=1, "Equalizer Length"=1, "Equalizer Delay"=-1}}
  "Input": c128[]
  "Error In": error
outputs:
  "Error Out": error
  "Output": c128[]
  "Frequency Offset": f64
types:
  T1 = cluster{"Training Sequence (derived)": c128[], "Zero Pad Length": i32}
  T2 = cluster{"Synchronization Method": string, "Fixed Offset": i32, "Symbol Timing Recovery Method": string, "Frame Detection Method": string, "Correct Frequency Offset": bool}
  T3 = enum{"none", "Raised Cosine", "Root Raised Cos", "Gaussian"}
  T4 = cluster{"Modulation Type": enum{"FSK", "PSK", "QAM", "MSK", "PAM", "ASK"}, "Pulse Shaping Filter": T3, "Filter Parameter": f64, "Filter Length (Symbols)": i32}
  T5 = cluster{"Equalization Method": string, "Channel Estimate Length": i32, "Equalizer Length": i32, "Equalizer Delay": i32}
  T6 = cluster{"Modulation Type": string, "Control Information\nfor Packet Header/Tail": T1, "RX Oversample Factor": i32, "Synchronization Options": T2, "Number of Data Symbols (Derived)": i32, "RX Sample Rate": f64, "Pulse Shaping Parameters": T4, "Channel Estimation/Equalization Parameters": T5}
diagram:
  Property Node(instance in=$"Modulation Parameters") -> ("RX Sample Rate"=w1, "RX Oversample Factor"=w2, "Channel Estimation/Equalization Parameters:Channel Estimate Length"=w3, "Control Information\nfor Packet Header/Tail:Training Sequence (derived)"=w4)
  Array Size(array=w4) -> (size(s)=w5)
  Decrement(x=w3) -> w6
  Complex Conjugate(x + iy=$Input) -> w7
  Decrement(x=w5) -> w8
  Subtract(x=w8, y=w6) -> w9
  for (N = w9) (iteration -> i1) {
    # L
    Add(w6, i1) -> w11
    # Nt-1
    Array Index(array=w7) -> (out0[w11]=w12)
    Add(w5, w11) -> w13
    Array Index(array=$Input) -> (out0[w13]=w14)
    Multiply(w12, w14) -> w15
    append w15 to w10
  }
  Add Array Elements(numeric array=w10) -> (sum=w16)
  Complex To Polar(r * e^(i*theta)=w16) -> (theta=w17)
  Multiply(PiTimes2, w5) -> w18
  Divide(x=w17, y=w18) -> w19
  Divide(x=w1, y=w2) -> w20
  Reciprocal(x=w20) -> w21
  Divide(x=w19, y=w21) -> w22
  $"Frequency Offset" <- w22
  Array Size(array=$Input) -> (size(s)=w23)
  for (N = w23) (iteration -> i2) {
    w24 = each element of $Input
    Multiply(w19, 0-1i, PiTimes2, i2) -> w26
    Exponential(x=w26) -> w27
    Multiply(w24, w27) -> w28
    append w28 to w25
  }
  $Output <- w25
  $"Error Out" <- $"Error In"
