vi "student_sliding_correlator.gvi"   [LabVIEW NXG]
inputs:
  "Modulation Parameters": T6 = {"Modulation Type"="QPSK", "Control Information\nfor Packet Header/Tail"={"Training Sequence (derived)"=[], "Zero Pad Length"=0}, "RX oversample factor"=20, "Synchronization Options"={"Synchronization Method"="Timing Estimation", "Fixed Offset"=0, "Symbol Timing Recovery Method"="Max Energy", "Frame Detection Method"="Sliding Correlator", "Correct Frequency Offset"=FALSE}, "Number of Data Symbols (Derived)"=100, "RX Sample Rate"=4000000, "Pulse Shaping Parameters"={"Modulation Type"="PSK", "Pulse Shaping Filter"="Root Raised Cos", "Filter Parameter"=0.5, "Filter Length (Symbols)"=8}, "Channel Estimation/Equalization Parameters"={"Equalization Method"="Direct", "channel estimate length"=1, "equalizer length"=1, "equalizer delay"=-1}}
  "Input Complex Waveform": cluster{"t0": f64, "dt": f64, "Y": c128[]} = {"t0"=0, "dt"=1, "Y"=[]}
  "error in (no error)": error
outputs:
  "Output": c128[]
  "Frame Offset": i32
  "Frequency Offset": f64
  "error out": error
types:
  T1 = cluster{"Training Sequence (derived)": c128[], "Zero Pad Length": i32}
  T2 = cluster{"Synchronization Method": string, "Fixed Offset": i32, "Symbol Timing Recovery Method": string, "Frame Detection Method": string, "Correct Frequency Offset": bool}
  T3 = enum{"none", "Raised Cosine", "Root Raised Cos", "Gaussian"}
  T4 = cluster{"Modulation Type": enum{"FSK", "PSK", "QAM", "MSK", "PAM", "ASK"}, "Pulse Shaping Filter": T3, "Filter Parameter": f64, "Filter Length (Symbols)": i32}
  T5 = cluster{"Equalization Method": string, "channel estimate length": i32, "equalizer length": i32, "equalizer delay": i32}
  T6 = cluster{"Modulation Type": string, "Control Information\nfor Packet Header/Tail": T1, "RX oversample factor": i32, "Synchronization Options": T2, "Number of Data Symbols (Derived)": i32, "RX Sample Rate": f64, "Pulse Shaping Parameters": T4, "Channel Estimation/Equalization Parameters": T5}
diagram:
  Property Node(instance in=$"Input Complex Waveform") -> ("Y"=w1)
  Property Node(instance in=$"Modulation Parameters") -> ("Control Information\nfor Packet Header/Tail:Training Sequence (derived)"=w2, "Synchronization Options:Correct Frequency Offset"=w3)
  Complex Conjugate(x + iy=w2) -> w4
  Array Size(array=w1) -> (size(s)=w5)
  Array Size(array=w2) -> (size(s)=w6)
  Decrement(x=w6) -> w7
  for (N = w5) (iteration -> i1) {
    # Nt-1
    # n
    for (N = w7) (iteration -> i2) {
      w9 = each element of w4
      # k
      Add(i1, i2) -> w11
      Array Index(array=w1) -> (out0[w11]=w12)
      Multiply(w12, w9) -> w13
      append w13 to w10
    }
    Add Array Elements(numeric array=w10) -> (sum=w14)
    Absolute Value(x=w14) -> w15
    Square(x=w15) -> w16
    append w16 to w8
  }
  Array Max And Min(array=w8) -> (max index(es)=w17)
  case (w3) {
    frame False, Default {
      Array Subset(array=w1, index0=w17) -> w18
      call "moose.gviprotected"(Modulation Parameters=$"Modulation Parameters", input=w18) -> (frequency offset=w20)
      w19 = $"error in (no error)"
    }
    frame True {
      Array Subset(array=w1, index0=w17) -> w21
      call "student_moose.gvi"(Modulation Parameters=$"Modulation Parameters", Input=w21) -> (Output=w18, Frequency Offset=w20)
      w19 = $"error in (no error)"
    }
  }
  $Output <- w18
  $"Frequency Offset" <- w20
  $"Frame Offset" <- w17
  $"error out" <- w19
